# Grasshopper definition assignment-01(1)_autosave.gh (Grasshopper 1.0.8)
# plug-ins: RhinoCodePluginGH

# Assignment-01: Bauhaus
number_slider = Slider(49, range=0..50)
number_slider_2 = Slider(50.657, range=-50.001..1000)
pt = Point(Point(0.1856236076, 0.1805289903, 4.502274665))
bool = Boolean(True)
bool_2 = Boolean(True)
pt_2 = Point(Point(887.3965571, 197.3628572, 51.07022538))
pt_3 = Point(Point(0.1856236076, -4.933238438, 856.4155705))
number_slider_3 = Slider(1.362, range=0..100)
pt_4 = Point(Point(-25.46295281, 95.76856204, 4.502274665))
pt_5 = Point(Point(-25.46295281, 95.76856204, 863.7602651))
pt_6 = Point(Point(885.5309638, 197.3628572, 132.0433773))
cerchio = Python3Script(cp=pt_2, r=number_slider)  # -> r, cerchio; inputs cp: Point3d
# ---------- cerchio: Python ----------
import importlib
import cdf.geometry_basics as geometry_basics

importlib.reload(geometry_basics)
cerchio=geometry_basics.create_circle(center_point=cp, radius=r)
# ---------- end cerchio ----------
sfera = Python3Script(cp=pt_3, rad=number_slider)  # -> out, my_sphere; inputs cp: Point3d
# ---------- sfera: Python ----------
from cdf import create_sphere
my_sphere = create_sphere (center_point= cp, radius= rad)
# ---------- end sfera ----------
box = Python3Script(cp=pt_4, wid=Slider(1080.652, range=-50.001..1500), dep=Slider(185, range=0..500), h=Slider(860, range=0..1000))  # -> out, box; inputs cp: Point3d
# ---------- box: Python ----------
import importlib
import cdf.geometry_basics as geometry_basics

importlib.reload(geometry_basics)
box = geometry_basics.create_box(corner_point=cp, width=wid, depth=dep, height=h)
# ---------- end box ----------
cilindro = Python3Script(bp=pt, h=Slider(50, range=0..50), r=number_slider, ct=bool_2, cb=bool)  # -> out, cylinder; inputs bp: Point3d
# ---------- cilindro: Python ----------
import importlib
import cdf.geometry_basics as geometry_basics

importlib.reload(geometry_basics)

cylinder = geometry_basics.create_cylinder(base_point=bp,height=h,radius=r,cap_top=ct,cap_bottom=cb)
# ---------- end cilindro ----------
box_2 = Python3Script(cp=pt_5, wid=number_slider, dep=Slider(198.38, range=0..500), h=Slider(361.631, range=0..1000))  # -> out, box; inputs cp: Point3d; same code as box
py3 = Python3Script(r=number_slider, k=Slider(2201, range=0..10000))  # -> out, lato
# ---------- py3: Python ----------
if r is None:
    raise ValueError("Manca il valore del raggio.")
lato = k/r
# ---------- end py3 ----------
py3_2 = Python3Script(cp=pt_6, l=py3.lato)  # -> l, quadrato
# ---------- py3_2: Python ----------
import importlib
import cdf.geometry_basics as geometry_basics

importlib.reload(geometry_basics)
quadrato=geometry_basics.create_square_curve(center_point=cp, side_length=l)
# ---------- end py3_2 ----------
number_slider_4 = Slider(-100, range=-100..100.001)
number_slider_5 = Slider(6.714, range=2..10)
py3_3 = Python3Script(count=number_slider_5)  # -> out, r
# ---------- py3_3: Python ----------
r=count*10
# ---------- end py3_3 ----------
py3_4 = Python3Script(count=number_slider_5)  # -> out, h
# ---------- py3_4: Python ----------
h=count*10
# ---------- end py3_4 ----------
py3_5 = Python3Script(b=box_2.box, d=Slider(206.467, range=0..1000), cp=Slider(5.196, range=-50.001..20), h=py3_4.h)  # -> out, boxes
# ---------- py3_5: Python ----------
import importlib
import cdf.geometry_basics as geometry_basics

importlib.reload(geometry_basics)
boxes = geometry_basics.copy_box_along_z_decreasing_height(box=b, distance=d, copy_count=cp, height_decrement=h)
# ---------- end py3_5 ----------
pt_7 = Point(Point(0.1856236076, 0.1805289903, 67.81319151))
number_slider_6 = Slider(215.792, range=0..500)
pt_8 = Point(Point(731.3250231, 75.36235073, 811.8430778))
transformation = Python3Script(my_sphere=sfera.my_sphere, distance=number_slider_4, count=number_slider_5)  # -> out, my_spheres; inputs my_sphere: Brep
# ---------- transformation: Python ----------
import importlib
import cdf.geometry_basics as geometry_basics

importlib.reload(geometry_basics)

my_spheres= geometry_basics.copy_brep_along_z(my_sphere, distance, count)
# ---------- end transformation ----------
pt_9 = Point(Point(779.3379124, 95.76856204, 42.42486061))
spirale = Python3Script(
    bp=pt_7,
    sp=pt_3,
    count=number_slider_5,
    distance=number_slider_4,
    n=Slider(6.541, range=-50.001..1000),
    rad=number_slider,
    lung=Slider(75.599, range=-50.001..1000),
    lato=Slider(7.907, range=-50.001..50))  # -> out, b, sweep; inputs bp: Point3d
# ---------- spirale: Python ----------
import importlib
import cdf.geometry_basics as geometry_basics

importlib.reload(geometry_basics)

spiral_length = sp.Z - bp.Z - abs(distance) * count
sweep = geometry_basics.sweep_square_along_helix(center_point=bp,turns=n,radius=rad,axis_length=spiral_length,side_length=lato)
b=spiral_length
# ---------- end spirale ----------
py3_6 = Python3Script(lato_a=spirale.b, k=Slider(63699.273, range=0..1000000))  # -> out, lato_b
# ---------- py3_6: Python ----------
lato_b=k/lato_a
# ---------- end py3_6 ----------
transformation_2 = Python3Script(quadrato=py3_2.quadrato, distance=Slider(226.58, range=-100..1000), count=Slider(3.734, range=2..10))  # -> out, my_quadrati; inputs quadrato: Curve
# ---------- transformation_2: Python ----------
import importlib
import cdf.geometry_basics as geometry_basics

importlib.reload(geometry_basics)

my_quadrati= geometry_basics.copy_curve_along_z(quadrato, distance, count)
# ---------- end transformation_2 ----------
transformation_3 = Python3Script(cerchio=cerchio.cerchio, distance=Slider(220.758, range=-100..1000), count=Slider(3.942, range=2..10))  # -> out, my_cerchi; inputs cerchio: Curve
# ---------- transformation_3: Python ----------
import importlib
import cdf.geometry_basics as geometry_basics

importlib.reload(geometry_basics)

my_cerchi= geometry_basics.copy_curve_along_z(cerchio, distance, count)
# ---------- end transformation_3 ----------
box_3 = Python3Script(cp=pt_8, box_side=py3_6.lato_b, dep=number_slider_6)  # -> out, box; inputs cp: Point3d
# ---------- box_3: Python ----------
import importlib
import cdf.geometry_basics as geometry_basics

importlib.reload(geometry_basics)

import Rhino.Geometry as rg

side = box_side 
box_corner = rg.Point3d(cp.X - side, cp.Y, cp.Z - side)

box = geometry_basics.create_box(corner_point=box_corner,width=side,depth=dep,height=side)
# ---------- end box_3 ----------
box_4 = Python3Script(cp=pt_9, wid=Slider(222.52, range=-50.001..1500), dep=Slider(185, range=0..500), h=Slider(767.728, range=0..1000))  # -> out, box; inputs cp: Point3d; same code as box
py3_7 = Python3Script(brep_a=box.box, brep_c=box_4.box, brep_b=box_3.box)  # -> out, differenza
# ---------- py3_7: Python ----------
import importlib
import cdf.geometry_basics as geometry_basics

importlib.reload(geometry_basics)
differenza= geometry_basics.boolean_difference(brep_a, brep_b, brep_c)
# ---------- end py3_7 ----------
merge = Merge(Data1=transformation_3.my_cerchi, Data2=cerchio.cerchio, Data3=py3_2.quadrato, Data4=transformation_2.my_quadrati)
pt_10 = Point(Point(134.6764878, -23.91257793, 64.1479365))
flatten = FlattenTree(Tree=merge, Path="{0}")
box_5 = Python3Script(cp=pt_10, wid=spirale.b, dep=Slider(203.392, range=0..500), h=spirale.b)  # -> out, box; inputs cp: Point3d; same code as box
py3_8 = Python3Script(
    rq=Slider(1, range=0..50),
    cp=pt_8,
    box_side=py3_6.lato_b,
    dep=number_slider_6,
    min_rad=Slider(8, range=0..50),
    max_rad=Slider(69, range=0..100),
    clear=Slider(38, range=0..50),
    seed=Slider(21, range=0..50))  # -> out, spheres; inputs seed: Int32
# ---------- py3_8: Python ----------
import Rhino.Geometry as rg
import importlib
import cdf.geometry_basics as geometry_basics

importlib.reload(geometry_basics)

side = box_side
box_corner = rg.Point3d(cp.X - side, cp.Y, cp.Z - side)


box = geometry_basics.create_box(
    corner_point=box_corner,
    width=side,
    depth=dep,
    height=side
)
reference_count = 2
reference_volume = 5 * 5 * 5

box_volume = side * dep * side  # larghezza × profondità × altezza
sq = int(reference_count * box_volume / reference_volume)

spheres = geometry_basics.create_random_spheres_in_cube(
    sphere_count=sq,  # sostituisci con il nome del tuo input
    corner_point=box_corner,
    width=side,
    depth=dep,
    height=side,
    min_radius=min_rad,
    max_radius=max_rad,
    clearance=clear,
    seed=seed
    
)
# ---------- end py3_8 ----------
py3_9 = Python3Script(profiles=flatten)  # -> out, a; inputs profiles: list
# ---------- py3_9: Python ----------
import Rhino.Geometry as rg

if profiles is None or len(profiles) < 2:
    raise ValueError("Collega almeno due curve chiuse.")

if any(profile is None or not profile.IsClosed for profile in profiles):
    raise ValueError("Tutte le sezioni devono essere curve chiuse.")

profiles = sorted(
    profiles,
    key=lambda curve: curve.GetBoundingBox(True).Center.Z)
lofts = rg.Brep.CreateFromLoft(
    profiles,
    rg.Point3d.Unset,
    rg.Point3d.Unset,
    rg.LoftType.Normal,
    False
)

if not lofts:
    raise RuntimeError("Il loft non ha prodotto una geometria.")

a = lofts[0].CapPlanarHoles(0.01)

if a is None or not a.IsSolid:
    raise RuntimeError("Il loft è stato creato, ma non è un solido chiuso.")
# ---------- end py3_9 ----------
swatch = ColourSwatch(SwatchColor=RGB(131, 24, 156))
lng = ListLength(List=py3_8.spheres)
preview = CustomPreview(Geometry=spirale.sweep, Material=ColourSwatch(SwatchColor=RGB(109, 180, 156)))
preview_2 = CustomPreview(Geometry=transformation.my_spheres, Material=swatch)
preview_3 = CustomPreview(Geometry=cilindro.cylinder, Material=ColourSwatch(SwatchColor=RGB(181, 33, 134)))
preview_4 = CustomPreview(Geometry=sfera.my_sphere, Material=swatch)
preview_5 = CustomPreview(Geometry=py3_7.differenza, Material=ColourSwatch(SwatchColor=RGB(222, 208, 134)))
preview_6 = CustomPreview(Geometry=box_5.box, Material=ColourSwatch(SwatchColor=RGB(27, 97, 134)))
preview_7 = CustomPreview(Geometry=py3_9.a, Material=ColourSwatch(SwatchColor=RGB(181, 33, 134)))
preview_8 = CustomPreview(Geometry=py3_5.boxes, Material=ColourSwatch(SwatchColor=RGB(109, 180, 156)))
dom = ConstructDomain(DomainStart=Slider(0, range=0..50), DomainEnd=Slider(2.99, range=0..2.99))
random = Random(Range=dom, Number=lng, Seed=2, Integers=False)
preview_9 = CustomPreview(Geometry=box_2.box, Material=ColourSwatch(SwatchColor=RGB(27, 97, 134)))
merge_2 = Merge(
    Data1=ColourSwatch(SwatchColor=RGB(45, 89, 134)),
    Data2=ColourSwatch(SwatchColor=RGB(246, 103, 134)),
    Data3=ColourSwatch(SwatchColor=RGB(30, 207, 134)))
item = ListItem(List=merge_2, Index=random, Wrap=True)
preview_10 = CustomPreview(Geometry=py3_8.spheres, Material=item)
