# Grasshopper definition assignment-01.gh (Grasshopper 1.0.8)
# plug-ins: RhinoCodePluginGH

# Assignment-01: Bauhaus
number_slider = Slider(39, range=0..50)
pt = Point(Point(0.1856236076, 0.1805289903, 4.502274665))
bool = Boolean(True)
bool_2 = Boolean(True)
pt_2 = Point(Point(1001.838889, 197.3628572, 0))
pt_3 = Point(Point(0.1856236076, -4.933238438, 856.4155705))
number_slider_2 = Slider(1.362, range=0..100)
pt_4 = Point(Point(-25.46295281, 95.76856204, 4.502274665))
pt_5 = Point(Point(-25.46295281, 95.76856204, 914.8166924))
pt_6 = Point(Point(1001.838889, 197.3628572, 94.61587264))
sfera = Python3Script(cp=pt_3, rad=number_slider)  # -> out, my_sphere; inputs cp: Point3d
# ---------- sfera: Python ----------
from cdf import create_sphere
my_sphere = create_sphere (center_point= cp, radius= rad)
# ---------- end sfera ----------
box = Python3Script(cp=pt_4, wid=Slider(830.393, range=-50.001..1000), dep=Slider(185, range=0..500), h=Slider(860, range=0..1000))  # -> out, box; inputs cp: Point3d
# ---------- box: Python ----------
import importlib
import cdf.geometry_basics as geometry_basics

importlib.reload(geometry_basics)
box = geometry_basics.create_box(corner_point=cp, width=wid, depth=dep, height=h)
# ---------- end box ----------
cilindro = Python3Script(bp=pt, h=Slider(50, range=0..50), r=number_slider, ct=bool_2, cb=bool)  # -> out, cylinder; inputs bp: Point3d
# ---------- cilindro: Python ----------
import importlib
import cdf.geometry_basics as geometry_basics

importlib.reload(geometry_basics)

cylinder = geometry_basics.create_cylinder(base_point=bp,height=h,radius=r,cap_top=ct,cap_bottom=cb)
# ---------- end cilindro ----------
box_2 = Python3Script(cp=pt_5, wid=Slider(50.657, range=-50.001..1000), dep=Slider(198.38, range=0..500), h=Slider(361.631, range=0..1000))  # -> out, box; inputs cp: Point3d; same code as box
number_slider_3 = Slider(-100, range=-100..100.001)
number_slider_4 = Slider(6.801, range=2..10)
py3 = Python3Script(count=number_slider_4)  # -> out, r
# ---------- py3: Python ----------
r=count*10
# ---------- end py3 ----------
py3_2 = Python3Script(count=number_slider_4)  # -> out, h
# ---------- py3_2: Python ----------
h=count*10
# ---------- end py3_2 ----------
cerchio = Python3Script(cp=pt_2, r=py3.r)  # -> r, cerchio; inputs cp: Point3d
# ---------- cerchio: Python ----------
import importlib
import cdf.geometry_basics as geometry_basics

importlib.reload(geometry_basics)
cerchio=geometry_basics.create_circle(center_point=cp, radius=r)
# ---------- end cerchio ----------
py3_3 = Python3Script(r=py3.r, k=Slider(4911, range=0..10000))  # -> out, lato
# ---------- py3_3: Python ----------
if r <= 0:
    raise ValueError("Il raggio deve essere maggiore di zero.")

lato= k / r
# ---------- end py3_3 ----------
py3_4 = Python3Script(b=box_2.box, d=Slider(198.541, range=0..1000), cp=Slider(5.123, range=-50.001..20), h=py3_2.h)  # -> out, boxes
# ---------- py3_4: Python ----------
import importlib
import cdf.geometry_basics as geometry_basics

importlib.reload(geometry_basics)
boxes = geometry_basics.copy_box_along_z_decreasing_height(box=b, distance=d, copy_count=cp, height_decrement=h)
# ---------- end py3_4 ----------
py3_5 = Python3Script(cp=pt_6, l=py3_3.lato)  # -> out, quadrato
# ---------- py3_5: Python ----------
import importlib
import cdf.geometry_basics as geometry_basics

importlib.reload(geometry_basics)
quadrato=geometry_basics.create_square_curve(center_point=cp, side_length=l)
# ---------- end py3_5 ----------
pt_7 = Point(Point(0.1856236076, 0.1805289903, 67.81319151))
pt_8 = Point(Point(731.3250231, 75.36235073, 811.8430778))
transformation = Python3Script(my_sphere=sfera.my_sphere, distance=number_slider_3, count=number_slider_4)  # -> out, my_spheres; inputs my_sphere: Brep
# ---------- transformation: Python ----------
import importlib
import cdf.geometry_basics as geometry_basics

importlib.reload(geometry_basics)

my_spheres= geometry_basics.copy_brep_along_z(my_sphere, distance, count)
# ---------- end transformation ----------
spirale = Python3Script(
    bp=pt_7,
    sp=pt_3,
    count=number_slider_4,
    distance=number_slider_3,
    n=Slider(6.541, range=-50.001..1000),
    rad=number_slider,
    lung=Slider(75.599, range=-50.001..1000),
    lato=Slider(7.907, range=-50.001..50))  # -> out, b, sweep; inputs bp: Point3d
# ---------- spirale: Python ----------
import importlib
import cdf.geometry_basics as geometry_basics

importlib.reload(geometry_basics)

spiral_length = sp.Z - bp.Z - abs(distance) * count
sweep = geometry_basics.sweep_square_along_helix(center_point=bp,turns=n,radius=rad,axis_length=spiral_length,side_length=lato)
b=spiral_length
# ---------- end spirale ----------
py3_6 = Python3Script(lato_a=spirale.b, k=Slider(63699.273, range=0..1000000))  # -> out, lato_b
# ---------- py3_6: Python ----------
lato_b=k/lato_a
# ---------- end py3_6 ----------
box_3 = Python3Script(cp=pt_8, box_side=py3_6.lato_b, dep=Slider(379.559, range=0..500))  # -> out, box; inputs cp: Point3d
# ---------- box_3: Python ----------
import importlib
import cdf.geometry_basics as geometry_basics

importlib.reload(geometry_basics)

import Rhino.Geometry as rg

side = box_side 
box_corner = rg.Point3d(cp.X - side, cp.Y, cp.Z - side)

box = geometry_basics.create_box(corner_point=box_corner,width=side,depth=dep,height=side)
# ---------- end box_3 ----------
py3_7 = Python3Script(brep_a=box.box, brep_b=box_3.box)  # -> out, differenza
# ---------- py3_7: Python ----------
import importlib
import cdf.geometry_basics as geometry_basics

importlib.reload(geometry_basics)
differenza= geometry_basics.boolean_difference(brep_a, brep_b)
# ---------- end py3_7 ----------
transformation_2 = Python3Script(quadrato=py3_5.quadrato, distance=Slider(226.58, range=-100..1000), count=Slider(3.734, range=2..10))  # -> out, my_quadrati; inputs quadrato: Curve
# ---------- transformation_2: Python ----------
import importlib
import cdf.geometry_basics as geometry_basics

importlib.reload(geometry_basics)

my_quadrati= geometry_basics.copy_curve_along_z(quadrato, distance, count)
# ---------- end transformation_2 ----------
transformation_3 = Python3Script(cerchio=cerchio.cerchio, distance=Slider(220.758, range=-100..1000), count=Slider(4.266, range=2..10))  # -> out, my_cerchi; inputs cerchio: Curve
# ---------- transformation_3: Python ----------
import importlib
import cdf.geometry_basics as geometry_basics

importlib.reload(geometry_basics)

my_cerchi= geometry_basics.copy_curve_along_z(cerchio, distance, count)
# ---------- end transformation_3 ----------
merge = Merge(Data1=transformation_3.my_cerchi, Data2=cerchio.cerchio, Data3=py3_5.quadrato, Data4=transformation_2.my_quadrati)
pt_9 = Point(Point(134.6764878, -23.91257793, 64.1479365))
flatten = FlattenTree(Tree=merge, Path="{0}")
box_4 = Python3Script(cp=pt_9, wid=spirale.b, dep=Slider(217.04, range=0..500), h=spirale.b)  # -> out, box; inputs cp: Point3d; same code as box
py3_8 = Python3Script(profiles=flatten)  # -> out, a; inputs profiles: list
# ---------- py3_8: Python ----------
import Rhino.Geometry as rg

if profiles is None or len(profiles) < 2:
    raise ValueError("Collega almeno due curve chiuse.")

if any(profile is None or not profile.IsClosed for profile in profiles):
    raise ValueError("Tutte le sezioni devono essere curve chiuse.")

profiles = sorted(
    profiles,
    key=lambda curve: curve.GetBoundingBox(True).Center.Z)
lofts = rg.Brep.CreateFromLoft(
    profiles,
    rg.Point3d.Unset,
    rg.Point3d.Unset,
    rg.LoftType.Normal,
    False
)

if not lofts:
    raise RuntimeError("Il loft non ha prodotto una geometria.")

a = lofts[0].CapPlanarHoles(0.01)

if a is None or not a.IsSolid:
    raise RuntimeError("Il loft è stato creato, ma non è un solido chiuso.")
# ---------- end py3_8 ----------
swatch = ColourSwatch(SwatchColor=RGB(131, 24, 156))
preview = CustomPreview(Geometry=spirale.sweep, Material=ColourSwatch(SwatchColor=RGB(109, 180, 156)))
preview_2 = CustomPreview(Geometry=transformation.my_spheres, Material=swatch)
preview_3 = CustomPreview(Geometry=cilindro.cylinder, Material=ColourSwatch(SwatchColor=RGB(181, 33, 134)))
preview_4 = CustomPreview(Geometry=sfera.my_sphere, Material=swatch)
preview_5 = CustomPreview(Geometry=py3_7.differenza, Material=ColourSwatch(SwatchColor=RGB(222, 208, 134)))
preview_6 = CustomPreview(Geometry=box_4.box, Material=ColourSwatch(SwatchColor=RGB(27, 97, 134)))
preview_7 = CustomPreview(Geometry=py3_8.a, Material=ColourSwatch(SwatchColor=RGB(181, 33, 134)))
preview_8 = CustomPreview(Geometry=py3_4.boxes, Material=ColourSwatch(SwatchColor=RGB(109, 180, 156)))
preview_9 = CustomPreview(Geometry=box_2.box, Material=ColourSwatch(SwatchColor=RGB(27, 97, 134)))
